# Grasshopper definition bouncy box.gh (Grasshopper 1.0.7)
# plug-ins: Heteroptera, Pufferfish

crv = Curve(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)
brec = BoundingRectangle(Geometry=crv, Plane=PlaneXY(0, 0, 0), Axis=0, Slide=0, Union=True)  # -> Bounding, DimensionX, DimensionY
explode = Explode(Curve=brec.Bounding, Recursive=True)  # -> Segments, Vertices
end = EndPoints(Curve=crv)  # -> Start, End
len = Length(Curve=explode.Segments)
number_slider = Slider(10, range=0..10)
sort = SortList(Keys=len, ValuesA=len)  # -> Keys, ValuesA
item = ListItem(List=sort.ValuesA, Index="-1", Wrap=True)
center = Center(Geometry=brec.Bounding)  # -> Center, Dimension
pt = ConstructPoint(XCoordinate=0, YCoordinate=0, ZCoordinate=0)
division = Division(A="1", B=item)
pt_2 = ConstructPoint(XCoordinate=Slider(0.29, range=0..1), YCoordinate=0, ZCoordinate=0)
scale = Scale(Geometry=crv, Center=pt, Factor=division)  # -> Geometry, Transform
multiplication = Multiplication()
yz = YZPlane(Origin=pt_2)
number_slider_2 = Slider(20, range=0..100)
pcx = CurvePlane(Curve=scale.Geometry, Plane=yz)  # -> Points, ParamsC, ParamsP
pdecon = Deconstruct(Point=pcx.Points)  # -> XComponent, YComponent, ZComponent
multiplication_2 = Multiplication(A=pdecon.YComponent, B=Slider(20, range=0..100))
rectangle = Rectangle(Plane=PlaneXY(0, 0, 0), XSize=number_slider_2, YSize=number_slider_2, Radius=0)  # -> Rectangle, Length
Z = UnitZ(Factor=multiplication_2)
extr = Extrude(Base=rectangle.Rectangle, Direction=Z)
cap = CapHoles(Brep=extr)
