# Grasshopper definition cube.ghx (Grasshopper 1.0.7)
# plug-ins: Heteroptera, Pufferfish, Weaverbird

data = Data([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])
data_2 = Data(simplify(data))
crv = Curve([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])
crv_2 = Curve([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])
crv_3 = Curve([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])
index = ItemIndex(List=data_2, Item=data_2)
group = Group(Objects=crv)
group_2 = Group(Objects=crv_2)
group_3 = Group(Objects=crv_3)
X = UnitX(Factor=Slider(63, range=0..100))
multiplication = Multiplication(A=index, B=X)  # -> simplify(flatten(Result))
merge = Merge(Data1=group, Data2=group_3, Data3=group_2)  # -> graft(Result)
move = Move(Geometry=data_2, Motion=multiplication)  # -> Geometry, Transform
panel = Panel(merge)
ungroup = Ungroup(Group=move.Geometry)  # -> simplify(Objects)
brec = BoundingRectangle(Geometry=merge, Plane=PlaneXY(0, 0, 0), Axis=0, Slide=0, Union=True)  # -> Bounding, DimensionX, DimensionY
explode = Explode(Curve=brec.Bounding, Recursive=True)  # -> simplify(Segments), Vertices
center = Center(Geometry=merge)  # -> Center, Dimension
pt = ConstructPoint(XCoordinate=0, YCoordinate=0, ZCoordinate=0)
item = ListItem(List=explode.Segments, Index=0, Wrap=True)
len = Length(Curve=item)  # -> flatten(Length)
sort = SortList(Keys=len, ValuesA=len)  # -> Keys, ValuesA
item_2 = ListItem(List=sort.ValuesA, Index="-1", Wrap=True)
division = Division(A=item_2, B=len)  # -> simplify(Result)
scale = Scale(Geometry=merge, Center=center.Center, Factor=graft(division))  # -> Geometry, Transform
move2pt = MoveToPoint(Geometry=scale.Geometry, PointA=center.Center, PointB=pt)  # -> flatten(Moved), Vector, Transform
item_3 = ListItem(List=move2pt.Moved, Index=Slider(0, range=0..2), Wrap=True)
item_4 = ListItem(List=move2pt.Moved, Index=0, Wrap=True)
ungroup_2 = Ungroup(Group=item_3)
end = EndPoints(Curve=ungroup_2)  # -> Start, End
vec2pt = Vector2Pt(PointA=end.Start, PointB=end.End, Unitize=True)  # -> Vector, Length
pdecon = Deconstruct(Point=vec2pt.Vector)  # -> XComponent, YComponent, ZComponent
abs = Absolute(Value=pdecon.YComponent)
abs_2 = Absolute(Value=pdecon.XComponent)
abs_3 = Absolute(Value=pdecon.ZComponent)
larger = LargerThan(FirstNumber=Slider(0.95, range=0..1), SecondNumber=abs)  # -> LargerThan, OrEqualTo
dispatch = Dispatch(List=ungroup_2, DispatchPattern=larger.LargerThan)  # -> ListA, ListB
crv_4 = Curve(dispatch.ListB)
end_2 = EndPoints(Curve=dispatch.ListA)  # -> Start, End
center_2 = Center(Geometry=crv_4, forall=True)  # -> Center, Dimension
crv_cp = CurveClosestPoint(Point=center_2.Center, Curve=crv_4)  # -> Point, Parameter, Distance
sort_2 = SortList(Keys=crv_cp.Distance, ValuesA=crv_4)  # -> Keys, ValuesA
item_5 = ListItem(List=sort_2.ValuesA, Index="0", Wrap=True)
crv_cp_2 = CurveClosestPoint(Point=end_2.Start, Curve=item_5)  # -> Point, Parameter, Distance
crv_cp_3 = CurveClosestPoint(Point=end_2.End, Curve=item_5)  # -> Point, Parameter, Distance
cull_i = CullIndex(List=sort_2.ValuesA, Indices="0", Wrap=True)
dist = Distance(PointA=crv_cp_2.Point, PointB=end_2.Start)
dist_2 = Distance(PointA=crv_cp_3.Point, PointB=end_2.End)
larger_2 = LargerThan(FirstNumber=dist, SecondNumber=dist_2)  # -> LargerThan, OrEqualTo
dispatch_2 = Dispatch(List=dispatch.ListA, DispatchPattern=larger_2.LargerThan)  # -> ListA, ListB
flip = FlipCurve(Curve=dispatch_2.ListA)  # -> Curve, Flag
merge_2 = Merge(Data1=flip.Curve, Data2=dispatch_2.ListB)
ext = ExtendCurve(Curve=merge_2, Type=0, Start="0", End=Slider(10000, range=0..10000))
mcx = MultipleCurves(Curves=ext)  # -> Points, IndexA, IndexB, ParamA, ParamB
crv_cp_4 = CurveClosestPoint(Point=mcx.Points, Curve=item_5)  # -> Point, Parameter, Distance
sort_3 = SortList(Keys=crv_cp_4.Distance, ValuesA=mcx.Points)  # -> Keys, ValuesA
end_3 = EndPoints(Curve=item_5)  # -> Start, End
item_6 = ListItem(List=sort_3.ValuesA, Index="-1", Wrap=True)  # -> Item1, Item
merge_3 = Merge(Data1=item_6.Item1, Data2=item_6.Item, Data3=end_3.Start, Data4=end_3.End)
merge_4 = Merge(Data1=item_6.Item1, Data2=item_6.Item)
del = DelaunayMesh(Points=merge_3, Plane=PlaneXY(0, 0, 0))
wbfacepolys = WeaverbirdsFacePolylines(Mesh=del)
center_3 = Center(Geometry=wbfacepolys)  # -> graft(Center), Dimension
cp = ClosestPoint(Point=center_3.Center, Cloud=merge_4)  # -> ClosestPoint, CPIndex, Distance
item_7 = ListItem(List=wbfacepolys, Index=cp.CPIndex, Wrap=True)  # -> simplify(Item)
explode_2 = Explode(Curve=item_7, Recursive=True)  # -> Segments, Vertices
end_4 = EndPoints(Curve=explode_2.Segments)  # -> Start, End
xy = XYPlane(Origin=simplify(center_3.Center))
vec2pt_2 = Vector2Pt(PointA=end_4.Start, PointB=end_4.End, Unitize=False)  # -> Vector, Length
shift = ShiftList(List=vec2pt_2.Vector, Shift=1, Wrap=True)
angle = Angle(VectorA=vec2pt_2.Vector, VectorB=shift, Plane=end_4.Start)  # -> simplify(Angle), simplify(Reflex)
deg = Degrees(Radians=angle.Reflex)
deg_2 = Degrees(Radians=angle.Angle)
data_3 = Data(item_5)
subtraction = Subtraction(A=deg, B="180")
len_2 = Length(Curve=data_3)
item_8 = ListItem(List=subtraction, Index="-1", Wrap=True)  # -> Item2, Item1, Item
rad = Radians(Degrees=item_8.Item2)
rad_2 = Radians(Degrees=item_8.Item1)
rad_3 = Radians(Degrees=item_8.Item)
trig = TriangleTrigonometry(Alpha=rad, Beta=rad_2, Gamma=rad_3, CLength=len_2)  # -> Alpha, Beta, Gamma, ALength, BLength, CLength
data_4 = Data(cull_i)
center_4 = Center(Geometry=data_4)  # -> Center, Dimension
center_5 = Center(Geometry=explode_2.Segments)  # -> Center, Dimension
pdecon_2 = Deconstruct(Point=center_5.Center)  # -> XComponent, YComponent, ZComponent
sort_4 = SortList(Keys=pdecon_2.YComponent, ValuesA=explode_2.Segments)  # -> Keys, ValuesA
item_9 = ListItem(List=sort_4.ValuesA, Index="-1", Wrap=True)
crv_5 = Curve(reparameterize(item_9))
end_5 = EndPoints(Curve=crv_5)  # -> Start, End
pdecon_3 = Deconstruct(Point=end_5.Start)  # -> XComponent, YComponent, ZComponent
pdecon_4 = Deconstruct(Point=end_5.End)  # -> XComponent, YComponent, ZComponent
larger_3 = LargerThan(FirstNumber=pdecon_3.YComponent, SecondNumber=pdecon_4.YComponent)  # -> LargerThan, OrEqualTo
ma = MassAddition(Input=flatten(trig.BLength))  # -> Result, PartialResults
dispatch_3 = Dispatch(List=crv_5, DispatchPattern=larger_3.LargerThan)  # -> ListA, ListB
yz = YZPlane(Origin=simplify(graft(center_4.Center)))
flip_2 = FlipCurve(Curve=dispatch_3.ListA)  # -> Curve, Flag
division_2 = Division(A=ma.Result, B="2")
dup = DuplicateData(Data=division_2, Number="2", Order=True)  # -> graft(Data)
merge_5 = Merge(Data1=flip_2.Curve, Data2=dispatch_3.ListB)  # -> simplify(Result)
pcx = CurvePlane(Curve=reparameterize(merge_5), Plane=yz)  # -> Points, ParamsC, ParamsP
data_5 = Data(simplify(len_2))
subtraction_2 = Subtraction(A="1", B=pcx.ParamsC)
division_3 = Division(A=data_5, B="2")
multiplication_2 = Multiplication(A=subtraction_2, B=dup)  # -> flatten(Result)
item_10 = ListItem(List=multiplication_2, Index=0, Wrap=True)  # -> Item, Item1
neg = Negative(Value=division_3)
panel_2 = Panel(pcx.ParamsC)
panel_3 = Panel(multiplication_2)
box = DomainBox(Base=PlaneXY(0, 0, 0), X=item_10.Item, Y=item_10.Item1, Z=neg)

# ---- group: RH_OUT:Mesh
mesh = Mesh(box)
