# Grasshopper definition cube3.gh (Grasshopper 1.0.7)
# plug-ins: Heteroptera, Pufferfish

data = Data([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])
data_2 = Data(simplify(data))
crv = Curve([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])
crv_2 = Curve([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])
crv_3 = Curve([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])
index = ItemIndex(List=data_2, Item=data_2)
group = Group(Objects=crv)
group_2 = Group(Objects=crv_2)
group_3 = Group(Objects=crv_3)
X = UnitX(Factor=Slider(63, range=0..100))
multiplication = Multiplication(A=index, B=X)  # -> simplify(flatten(Result))
merge = Merge(Data1=group, Data2=group_2, Data3=group_3)  # -> graft(Result)
move = Move(Geometry=data_2, Motion=multiplication)  # -> Geometry, Transform
ungroup = Ungroup(Group=move.Geometry)  # -> simplify(Objects)
brec = BoundingRectangle(Geometry=merge, Plane=PlaneXY(0, 0, 0), Axis=0, Slide=0, Union=True)  # -> Bounding, DimensionX, DimensionY
explode = Explode(Curve=brec.Bounding, Recursive=True)  # -> simplify(Segments), Vertices
center = Center(Geometry=merge)  # -> Center, Dimension
pt = ConstructPoint(XCoordinate=0, YCoordinate=0, ZCoordinate=0)
item = ListItem(List=explode.Segments, Index=0, Wrap=True)
len = Length(Curve=item)  # -> flatten(Length)
sort = SortList(Keys=len, ValuesA=len)  # -> Keys, ValuesA
crv_4 = Curve([<curve referenced from the Rhino model> x22])
crv_5 = Curve([<curve referenced from the Rhino model> x21])
crv_6 = Curve([<curve referenced from the Rhino model> x21])
crv_7 = Curve([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, <curve referenced from the Rhino model>, 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])
crv_8 = Curve([<curve referenced from the Rhino model> x21])
crv_9 = Curve([<curve referenced from the Rhino model> x21])
item_2 = ListItem(List=sort.ValuesA, Index="-1", Wrap=True)
crv_10 = Curve([<curve referenced from the Rhino model> x7])
division = Division(A=item_2, B=len)  # -> simplify(Result)
scale = Scale(Geometry=merge, Center=center.Center, Factor=graft(division))  # -> Geometry, Transform
end = EndPoints(Curve=crv_9)  # -> Start, End
vec2pt = Vector2Pt(PointA=end.Start, PointB=end.End, Unitize=True)  # -> Vector, Length
move2pt = MoveToPoint(Geometry=scale.Geometry, PointA=center.Center, PointB=pt)  # -> flatten(Moved), Vector, Transform
pdecon = Deconstruct(Point=vec2pt.Vector)  # -> XComponent, YComponent, ZComponent
item_3 = ListItem(List=move2pt.Moved, Index=0, Wrap=True)
abs = Absolute(Value=pdecon.YComponent)
item_4 = ListItem(List=move2pt.Moved, Index=Slider(0, range=0..2), Wrap=True)
crv_11 = Curve([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])
ungroup_2 = Ungroup(Group=item_4)
ma = MassAddition(Input=abs)  # -> Result, PartialResults
lng = ListLength(List=abs)
end_2 = EndPoints(Curve=crv_11)  # -> Start, End
panel = Panel(item_4)
division_2 = Division(A=ma.Result, B=lng)
vec2pt_2 = Vector2Pt(PointA=end_2.Start, PointB=end_2.End, Unitize=True)  # -> Vector, Length
larger = LargerThan(FirstNumber=division_2, SecondNumber=abs)  # -> LargerThan, OrEqualTo
pdecon_2 = Deconstruct(Point=vec2pt_2.Vector)  # -> XComponent, YComponent, ZComponent
dispatch = Dispatch(List=crv_9, DispatchPattern=larger.LargerThan)  # -> ListA, ListB
abs_2 = Absolute(Value=pdecon_2.YComponent)
abs_3 = Absolute(Value=pdecon_2.XComponent)
abs_4 = Absolute(Value=pdecon_2.ZComponent)
crv_12 = Curve(graft(dispatch.ListB))
larger_2 = LargerThan(FirstNumber=Slider(0.95, range=0..1), SecondNumber=abs_2)  # -> LargerThan, OrEqualTo
end_3 = EndPoints(Curve=crv_12)  # -> Start, End
dispatch_2 = Dispatch(List=crv_11, DispatchPattern=larger_2.LargerThan)  # -> ListA, ListB
merge_2 = Merge(Data1=end_3.Start, Data2=end_3.End)
clean = CleanTree(RemoveNulls=True, RemoveInvalid=True, RemoveEmpty=True, Tree=crv_12)
crv_13 = Curve(dispatch_2.ListB)
end_4 = EndPoints(Curve=dispatch_2.ListA)  # -> Start, End
pdecon_3 = Deconstruct(Point=merge_2)  # -> XComponent, YComponent, ZComponent
center_2 = Center(Geometry=crv_13, forall=True)  # -> Center, Dimension
center_3 = Center(Geometry=flatten(clean), forall=True)  # -> Center, Dimension
center_4 = Center(Geometry=clean)  # -> Center, Dimension
len_2 = Length(Curve=clean)
sort_2 = SortList(Keys=pdecon_3.YComponent, ValuesA=merge_2)  # -> Keys, ValuesA
crv_14 = Curve(flatten(dispatch.ListA))
dist = Distance(PointA=center_3.Center, PointB=center_4.Center)
crv_cp = CurveClosestPoint(Point=center_2.Center, Curve=crv_13)  # -> Point, Parameter, Distance
item_5 = ListItem(List=sort_2.ValuesA, Index="-1", Wrap=True)
group_4 = Group(Objects=crv_14)
lng_2 = ListLength(List=flatten(item_5))
division_3 = Division(A="1", B=dist)
sort_3 = SortList(Keys=crv_cp.Distance, ValuesA=crv_13)  # -> Keys, ValuesA
multiplication_2 = Multiplication(A=division_3, B=len_2)  # -> flatten(Result)
crv_cp_2 = CurveClosestPoint(Point=item_5, Curve=crv_14)  # -> Point, Parameter, simplify(Distance)
dup = DuplicateData(Data=group_4, Number=lng_2, Order=True)
item_6 = ListItem(List=sort_3.ValuesA, Index="0", Wrap=True)
crv_cp_3 = CurveClosestPoint(Point=end_4.Start, Curve=item_6)  # -> Point, Parameter, Distance
crv_cp_4 = CurveClosestPoint(Point=end_4.End, Curve=item_6)  # -> Point, Parameter, Distance
cull_i = CullIndex(List=sort_3.ValuesA, Indices="0", Wrap=True)
ungroup_3 = Ungroup(Group=dup)  # -> simplify(Objects)
sort_4 = SortList(Keys=multiplication_2, ValuesA=flatten(clean))  # -> Keys, ValuesA
dist_2 = Distance(PointA=crv_cp_3.Point, PointB=end_4.Start)
dist_3 = Distance(PointA=crv_cp_4.Point, PointB=end_4.End)
item_7 = ListItem(List=sort_4.ValuesA, Index="-1", Wrap=True)
sort_5 = SortList(Keys=crv_cp_2.Distance, ValuesA=ungroup_3)  # -> Keys, ValuesA
end_5 = EndPoints(Curve=item_7)  # -> Start, End
vec2pt_3 = Vector2Pt(PointA=end_5.Start, PointB=end_5.End, Unitize=True)  # -> Vector, Length
item_8 = ListItem(List=sort_5.ValuesA, Index=0, Wrap=True)  # -> Item, Item1
pdecon_4 = Deconstruct(Point=vec2pt_3.Vector)  # -> XComponent, YComponent, ZComponent
data_3 = Data(simplify(item_5))
larger_3 = LargerThan(FirstNumber=pdecon_4.YComponent, SecondNumber="0")  # -> LargerThan, OrEqualTo
merge_3 = Merge(Data1=item_8.Item, Data2=item_8.Item1)
curvepoint = PointOnCurve(item_7, parameter=0.823)
dispatch_3 = Dispatch(List=item_7, DispatchPattern=larger_3.LargerThan)  # -> ListA, ListB
midpt = CurveMiddle(Curve=merge_3)
flip = FlipCurve(Curve=dispatch_3.ListB)  # -> Curve, Flag
panel_2 = Panel(larger_3.LargerThan)
dist_4 = Distance(PointA=data_3, PointB=midpt)
crv_15 = Curve(flatten(dispatch.ListA))
merge_4 = Merge(Data1=dispatch_3.ListA, Data2=flip.Curve)
len_3 = Length(Curve=merge_3)  # -> expr("x/2", Length)
end_6 = EndPoints(Curve=merge_4)  # -> Start, End
multiplication_3 = Multiplication(A=len_3, B=Slider(0.06, range=0..0.1))
center_5 = Center(Geometry=crv_15, forall=True)  # -> Center, Dimension
equalst = EqualityWithinTolerance(FirstNumber=len_3, SecondNumber=dist_4, Tolerance=multiplication_3)  # -> Equality, Inequality
crv_cp_5 = CurveClosestPoint(Point=end_6.Start, Curve=crv_15)  # -> Point, Parameter, Distance
crv_cp_6 = CurveClosestPoint(Point=end_6.End, Curve=crv_15)  # -> Point, Parameter, Distance
data_4 = Data(crv_12)
X_2 = UnitX(Factor="1000")
item_9 = ListItem(List=equalst.Equality, Index=0, Wrap=True)  # -> Item, Item1
merge_5 = Merge(Data1=end_6.Start, Data2=end_6.End)
sort_6 = SortList(Keys=crv_cp_5.Distance, ValuesA=crv_15)  # -> Keys, ValuesA
neg = Negative(Value=X_2)
sort_7 = SortList(Keys=crv_cp_6.Distance, ValuesA=crv_15)  # -> Keys, ValuesA
and = GateAnd(A=item_9.Item, B=item_9.Item1)
item_10 = ListItem(List=sort_6.ValuesA, Index=0, Wrap=True)  # -> Item, Item1
item_11 = ListItem(List=sort_7.ValuesA, Index=0, Wrap=True)  # -> Item, Item1
dispatch_4 = Dispatch(List=data_4, DispatchPattern=and)  # -> ListA, ListB
move_2 = Move(Geometry=center_5.Center, Motion=[X_2, neg])  # -> Geometry, Transform
dup_2 = DuplicateData(Data=and, Number="2", Order=True)
dispatch_5 = Dispatch(List=merge_3, DispatchPattern=dup_2)  # -> ListA, ListB
data_5 = Data(simplify(dispatch_5.ListA))
merge_6 = Merge(Data1=item_10.Item, Data2=item_10.Item1)
data_6 = Data(simplify(dispatch_4.ListA))
merge_7 = Merge(Data1=item_11.Item, Data2=item_11.Item1)
item_12 = ListItem(List=move_2.Geometry, Index=0, Wrap=True)  # -> Item, Item1
ln = Line(StartPoint=item_12.Item1, EndPoint=item_12.Item)
midpt_2 = CurveMiddle(Curve=merge_7)
midpt_3 = CurveMiddle(Curve=merge_6)
alongcrv = SortAlongCurve(Points=midpt_2, Curve=ln)  # -> Points, Indices
merge_8 = Merge(Data1=data_5, Data2=data_6)
alongcrv_2 = SortAlongCurve(Points=midpt_3, Curve=ln)  # -> Points, Indices
item_13 = ListItem(List=merge_7, Index=alongcrv.Indices, Wrap=True)
item_14 = ListItem(List=merge_6, Index=alongcrv_2.Indices, Wrap=True)
clean_2 = CleanTree(RemoveNulls=True, RemoveInvalid=True, RemoveEmpty=True, Tree=merge_8)
end_7 = EndPoints(Curve=item_14)  # -> Start, End
len_4 = Length(Curve=clean_2)
end_8 = EndPoints(Curve=item_13)  # -> Start, End
ma_2 = MassAddition(Input=len_4)  # -> flatten(Result), PartialResults
group_5 = Group(Objects=clean_2)  # -> flatten(Group)
ln_2 = Line(StartPoint=end_7.Start, EndPoint=end_7.End)
ln_3 = Line(StartPoint=end_8.Start, EndPoint=end_8.End)
sort_8 = SortList(Keys=ma_2.Result, ValuesA=group_5)  # -> Keys, ValuesA
crv_cp_7 = CurveClosestPoint(Point=end_6.Start, Curve=ln_2)  # -> Point, Parameter, Distance
crv_cp_8 = CurveClosestPoint(Point=end_6.End, Curve=ln_3)  # -> Point, Parameter, Distance
panel_3 = Panel("20")
item_15 = ListItem(List=sort_8.ValuesA, Index="-1", Wrap=True)
lng_3 = ListLength(List=sort_8.ValuesA)  # -> expr("X-1", Length)
panel_4 = Panel(lng_3)
ungroup_4 = Ungroup(Group=item_15)
cull_i_2 = CullIndex(List=sort_8.ValuesA, Indices=lng_3, Wrap=True)
item_16 = ListItem(List=ungroup_4, Index="-1", Wrap=True)  # -> Item2, Item1, Item
len_5 = Length(Curve=item_16.Item)  # -> expr("X/2", Length)
crv_16 = Curve(ln_3)
center_6 = Center(Geometry=cull_i_2)  # -> Center, Dimension
neg_2 = Negative(Value=len_5)
len_6 = Length(Curve=crv_16)  # -> expr("X*.05", Length)
rectangle = Rectangle(Plane=PlaneXY(0, 0, 0), XSize=item_16.Item2, YSize=item_16.Item1, Radius=0)  # -> Rectangle, Length
end_9 = EndPoints(Curve=crv_16)  # -> Start, End
side = CurveSide(Curve=item_16.Item, Point=center_6.Center)  # -> Side, Left, Right
Z = UnitZ(Factor=len_5)
item_17 = ListItem(List=len_6, Index=0, Wrap=True)
extr = Extrude(Base=rectangle.Rectangle, Direction=Z)
pgroups = PointGroups(Points=[end_9.Start, end_9.End], Distance=item_17)  # -> Groups, Indices
center_7 = Center(Geometry=pgroups.Groups, forall=True)  # -> flatten(Center), Dimension
pdecon_5 = Deconstruct(Point=center_7.Center)  # -> XComponent, YComponent, ZComponent
data_7 = Data(cull_i)
sort_9 = SortList(Keys=pdecon_5.XComponent, ValuesA=center_7.Center)  # -> Keys, ValuesA
center_8 = Center(Geometry=item_16.Item)  # -> Center, Dimension
center_9 = Center(Geometry=data_7)  # -> Center, Dimension
pline = PolyLine(Vertices=sort_9.ValuesA, Closed=False)
scale_2 = Scale(Geometry=item_16.Item, Center=center_8.Center, Factor=Slider(3, range=0..10))  # -> Geometry, Transform
explode_2 = Explode(Curve=pline, Recursive=True)  # -> Segments, Vertices
center_10 = Center(Geometry=explode_2.Segments)  # -> Center, Dimension
side_2 = CurveSide(Curve=scale_2.Geometry, Point=center_10.Center)  # -> Side, Left, Right
dispatch_6 = Dispatch(List=explode_2.Segments, DispatchPattern=side_2.Left)  # -> ListA, ListB
dispatch_7 = Dispatch(List=cull_i_2, DispatchPattern=side.Left)  # -> ListA, ListB
ungroup_5 = Ungroup(Group=dispatch_7.ListB)
ungroup_6 = Ungroup(Group=dispatch_7.ListA)
item_18 = ListItem(List=ungroup_5, Index="-1", Wrap=True)  # -> Item2, Item1, Item
midpt_4 = CurveMiddle(Curve=item_18.Item)
item_19 = ListItem(List=ungroup_6, Index="-1", Wrap=True)  # -> Item2, Item1, Item
yz = YZPlane(Origin=midpt_4)
midpt_5 = CurveMiddle(Curve=item_19.Item)
flip_2 = FlipCurve(Curve=dispatch_6.ListB)  # -> reparameterize(Curve), Flag
len_7 = Length(Curve=item_18.Item2)
len_8 = Length(Curve=item_18.Item1)
yz_2 = YZPlane(Origin=midpt_5)
pcx = CurvePlane(Curve=flip_2.Curve, Plane=yz)  # -> Points, ParamsC, ParamsP
len_9 = Length(Curve=dispatch_6.ListB)
neg_3 = Negative(Value=len_7)
flip_3 = FlipCurve(Curve=dispatch_6.ListA)  # -> reparameterize(Curve), Flag
len_10 = Length(Curve=item_19.Item2)
len_11 = Length(Curve=item_19.Item1)
multiplication_4 = Multiplication(A=pcx.ParamsC, B=len_9)
pcx_2 = CurvePlane(Curve=flip_3.Curve, Plane=yz_2)  # -> Points, ParamsC, ParamsP
len_12 = Length(Curve=dispatch_6.ListA)
pt_2 = ConstructPoint(XCoordinate=0, YCoordinate=multiplication_4, ZCoordinate=0)
neg_4 = Negative(Value=len_10)
neg_5 = Negative(Value=len_11)
multiplication_5 = Multiplication(A=pcx_2.ParamsC, B=len_12)
rectangle_2 = Rectangle(Plane=pt_2, XSize=neg_3, YSize=len_8, Radius=0)  # -> Rectangle, Length
pt_3 = ConstructPoint(XCoordinate=multiplication_5, YCoordinate=0, ZCoordinate=0)
len_13 = Length(Curve=item_18.Item)
Z_2 = UnitZ(Factor=len_13)  # -> expr("x/2", UnitVector)
rectangle_3 = Rectangle(Plane=pt_3, XSize=neg_5, YSize=neg_4, Radius=0)  # -> Rectangle, Length
len_14 = Length(Curve=item_19.Item)
data_8 = Data(item_16.Item)
extr_2 = Extrude(Base=rectangle_2.Rectangle, Direction=Z_2)
Z_3 = UnitZ(Factor=len_14)  # -> expr("x/2", UnitVector)
len_15 = Length(Curve=data_8)
extr_3 = Extrude(Base=rectangle_3.Rectangle, Direction=Z_3)
division_4 = Division(A=len_15, B="2")
Z_4 = UnitZ(Factor=division_4)
cap = CapHoles(Brep=extr)
cap_2 = CapHoles(Brep=extr_2)
cap_3 = CapHoles(Brep=extr_3)
sunion = SolidUnion(Breps=flatten([cap_3, cap_2, cap]))
mesh = Mesh(sunion)
panel_5 = Panel(mesh)
preview = CustomPreview(Geometry=mesh, Material=ColourSwatch(SwatchColor=RGB(255, 255, 255)))
